# Grasshopper definition profit_test.gh (Grasshopper 1.0.7)

plotlines = Curve([<curve referenced from the Rhino model> x165])
streetcrv = Curve([<curve referenced from the Rhino model> x72])
cull_roads_polygons = CullRoadsPolygons(roads_curves=streetcrv, plots_curves=plotlines)
cls = Closed(Curve=cull_roads_polygons)  # -> Closed, Periodic
cull = CullPattern(List=cull_roads_polygons, CullPattern=cls.Closed)
panel = Panel(cls.Closed)
min_area = Slider(150, range=0..200)
area = Area(Geometry=cull)  # -> Area, Centroid
larger = LargerThan(FirstNumber=area.Area, SecondNumber=min_area)  # -> LargerThan, OrEqualTo
cull_2 = CullPattern(List=cull_roads_polygons, CullPattern=larger.OrEqualTo)
redpline = Reduce(Polyline=cull_2, Tolerance=1)  # -> Polyline, Reduction
explode = Explode(Curve=redpline.Polyline, Recursive=True)  # -> Segments, Vertices
midpt = CurveMiddle(Curve=explode.Segments)
divlength = DivideLength(Curve=streetcrv, Length="10")  # -> Points, Tangents, Parameters
plot_distance_to_road_tolerance = Slider(16.5, range=0..30)
cp = ClosestPoint(Point=midpt, Cloud=flatten(divlength.Points))  # -> ClosestPoint, CPIndex, Distance
smaller = SmallerThan(FirstNumber=cp.Distance, SecondNumber=plot_distance_to_road_tolerance)  # -> SmallerThan, OrEqualTo
dispatch = Dispatch(List=explode.Segments, DispatchPattern=smaller.OrEqualTo)  # -> FrontLines, OtherLines
dispatch_2 = Dispatch(List=cp.Distance, DispatchPattern=smaller.OrEqualTo)  # -> FrontDist, OtherDist
sort = SortList(Keys=dispatch_2.OtherDist, ValuesA=dispatch.OtherLines)  # -> Keys, ValuesA
panel_2 = Panel("""0
1""")

# ---- group: side lines
item = ListItem(List=sort.ValuesA, Index=panel_2, Wrap=True)

# ---- group: back lines
cull_i = CullIndex(List=sort.ValuesA, Indices=panel_2, Wrap=True)

# ---- group: front lines
crv = Curve(dispatch.FrontLines)

# ----
front_lines = Slider(3, range=0..10)
side_lines = Slider(3, range=0..10)
back_lines = Slider(5, range=0..10)
offset_buildinglines = Offset_BuildingLines(curves=item, minlengthtolerance="3", distance=side_lines)
offset_buildinglines_2 = Offset_BuildingLines(curves=crv, minlengthtolerance="3", distance=front_lines)
offset_buildinglines_3 = Offset_BuildingLines(curves=cull_i, minlengthtolerance="3", distance=back_lines)
weave = Weave(
    Pattern=[0, 1, 2],
    Stream0=offset_buildinglines_2,
    Stream1=offset_buildinglines,
    Stream2=offset_buildinglines_3,
    NullGaps=False)
find_dup_curves = GhPythonScript(curves=weave)  # -> out, pattern; inputs curves: list of Curve
# ---------- find_dup_curves: Python ----------
__author__ = "ASAF"
__version__ = "2021.03.21"

import rhinoscriptsyntax as rs
import Rhino.Geometry as rg


pattern = []
for i in range(len(curves)):
    boll = rg.GeometryBase.GeometryEquals(curves[i],curves[i-1])
    pattern.append(boll)
"""

for crv in curves:
    for i in range(len(curves)):
        boll = rg.GeometryBase.GeometryEquals(crv,curves[i][j])
        pattern.append(boll)
"""
# ---------- end find_dup_curves ----------
cull_3 = CullPattern(List=weave, CullPattern=invert(find_dup_curves.pattern))
python = GhPythonScript(curves=cull_3)  # -> out, curves
# ---------- python: Python ----------
__author__ = "ASAF"
__version__ = "2021.03.21"

import rhinoscriptsyntax as rs
import Rhino.Geometry as rg

curves = []

for i in range(len(curves)):
    
    curves[i].Extend(rg.CurveEnd(1),rg.CurveExtensionStyle(0),curves)
# ---------- end python ----------
panel_3 = Panel(python.curves)
mcx = MultipleCurves(Curves=cull_3)  # -> Points, IndexA, IndexB, ParamA, ParamB
cullpt = CullDuplicates(Points=mcx.Points, Tolerance=0.1, CullMode=3)  # -> Points, Indices, Valence
sort_points = GhPythonScript(iPoints=cullpt.Points)  # -> out, a; inputs iPoints: list of Point3d
# ---------- sort_points: Python ----------
__author__ = "ASAF"
__version__ = "2021.03.10"

import rhinoscriptsyntax as rs
import Rhino.Geometry as rg


sorted = rg.Point3d.SortAndCullPointList(iPoints,1)

a = sorted
# ---------- end sort_points ----------
pline = PolyLine(Vertices=sort_points.a, Closed=True)
# לבדוק אם זה הכרחי למיין שוב את החלקות לפי שטח
main_streets = Curve([<curve referenced from the Rhino model> x19])
boundary = BoundarySurfaces(Edges=pline)  # -> flatten(Surfaces)
area_2 = Area(Geometry=boundary)  # -> Area, Centroid
panel_4 = Panel(boundary)
smaller_2 = SmallerThan(FirstNumber=area_2.Area, SecondNumber=Slider(150, range=0..1000))  # -> SmallerThan, OrEqualTo
cull_4 = CullPattern(List=boundary, CullPattern=invert(smaller_2.SmallerThan))
area_3 = Area(Geometry=cull_4)  # -> Area, Centroid
crv_cp = CurveClosestPoint(Point=graft(area_3.Centroid), Curve=main_streets)  # -> Point, Parameter, Distance
sort_2 = SortList(Keys=crv_cp.Distance, ValuesA=crv_cp.Distance)  # -> Keys, ValuesA
item_2 = ListItem(List=sort_2.ValuesA, Index=0, Wrap=True)
larger_2 = LargerThan(FirstNumber=item_2, SecondNumber=Slider(43, range=0..100))  # -> LargerThan, OrEqualTo
dispatch_3 = Dispatch(List=graft(cull_4), DispatchPattern=larger_2.LargerThan)  # -> SideStreets, MainStreets

# ---- group: side strees buildings
number_slider = Slider(8, range=1..20)
multiplication = Multiplication(A=number_slider, B="3")
Z = UnitZ(Factor=multiplication)
extr = Extrude(Base=dispatch_3.SideStreets, Direction=Z)

# ---- group: main street buildings
number_slider_2 = Slider(15, range=1..30)
multiplication_2 = Multiplication(A=number_slider_2, B="3")
Z_2 = UnitZ(Factor=multiplication_2)
extr_2 = Extrude(Base=dispatch_3.MainStreets, Direction=Z_2)

# ----
panel_5 = Panel(extr_2)
area_4 = Area(Geometry=dispatch_3.SideStreets)  # -> Area, Centroid
area_5 = Area(Geometry=dispatch_3.MainStreets)  # -> Area, Centroid

# ---- group: raplace with real list and delete!!!
lng = ListLength(List=flatten(area_4.Area))
random = Random(Range="10.0 to 20.0", Number=lng, Seed=2)
round = Round(Number=random)  # -> Nearest, Floor, Ceiling

lng_2 = ListLength(List=flatten(area_5.Area))
random_2 = Random(Range="10.0 to 20.0", Number=lng_2, Seed=2)
round_2 = Round(Number=random_2)  # -> Nearest, Floor, Ceiling

# ----
unitaveragesize = Slider(80, range=40..250)
python_2 = GhPythonScript(
    buildings=extr,
    floorArea=area_4.Area,
    floorNum=number_slider,
    oldUnitsNum=round.Nearest,
    unitAverageSize=unitaveragesize)  # -> out, newUnitsNum, income, outcome, port, Pass, Fail, port_2, profit; inputs buildings: list, floorArea: list of Int32, floorNum: Int32, oldUnitsNum: list of Int32, unitAverageSize: Int32
# ---------- python_2: Python ----------
__author__ = "Dor"
__version__ = "2021.03.14"

import rhinoscriptsyntax as rs
import scriptcontext as sc
import Rhino as rh
import math

# set scriptcontext.doc to Rhino.ActiveDoc
sc.doc = rh.RhinoDoc.ActiveDoc

### claculate number of new units

listLen = len(floorArea)

core = 45
if floorNum > 10:
    core = 125

buildingTotalArea =[]
netAreas = []
newUnitsNum = []

for i in range(listLen):
    area = floorNum*floorArea[i]
    buildingTotalArea.append(area)

mmdList = []



for i in range(len(buildingTotalArea)):
    
    ### very ugly code
    plot_objs = rs.ObjectsByLayer("H0010A")
    building_center_pt = ghdoc.Objects.FindGeometry(buildings[0]).GetBoundingBox(True).Center
    for plot_obj in plot_objs:
        if rs.PointInPlanarClosedCurve(building_center_pt, plot_obj):
            oldUnitsNum[i] = int(rs.GetUserText(plot_obj, "NUM_APTS_C"))
    ### very ugly code


    mmd = oldUnitsNum[i]*12
    mmdList.append(mmd)
    net = int(buildingTotalArea[i])-(floorNum*core)-mmdList[i]
    netAreas.append(net)


for i in range(listLen):
    num = netAreas[i]/unitAverageSize 
    newUnitsNum.append(int(num))

##############################################################################

### claculta income

salePrice = 25000
averagePrice = unitAverageSize*salePrice

income =[]

for i in range(listLen):
    totalPrice = newUnitsNum[i]*averagePrice
    income.append(totalPrice)

##############################################################################

### calculate outcome

buildingTime = 24
rent = 6000
housingCost = []

for i in range(listLen):
    ### very ugly code
    plot_objs = rs.ObjectsByLayer("H0010A")
    building_center_pt = ghdoc.Objects.FindGeometry(buildings[0]).GetBoundingBox(True).Center
    for plot_obj in plot_objs:
        if rs.PointInPlanarClosedCurve(building_center_pt, plot_obj):
            oldUnitsNum[i] = int(rs.GetUserText(plot_obj, "NUM_APTS_C"))             
    ### very ugly code
    
    cost = oldUnitsNum[i]*buildingTime*rent
    housingCost.append(cost)
    #print len(oldUnitsNum)

outcome = []
resedntialCost = []
basementCost =[]
buildingCost = []

#resedntialCost
for i in range(listLen):
    cost = buildingTotalArea[i]*5500
    resedntialCost.append(cost)
#basementCost
for i in range(listLen):
    cost = newUnitsNum[i]*45*3000
    basementCost.append(cost)
#buildingCost
for i in range(listLen):
    cost = resedntialCost[i] + basementCost[i]
    buildingCost.append(cost)

#outcome
for i in range(listLen):
    cost = (buildingCost[i]*1.3)+housingCost[i]
    outcome.append(int(cost))

#(( buildingTotalArea*5500 + newUnitsNum*45*3000 ) *1.3 + housingCost


##############################################################################

### test profit

Pass = []
Fail =[]

for i in range(listLen):
    
    profit = round(income[i]/outcome[i],2)
    
    
    if income[i]/outcome[i] > 1.2:
        
        Pass.append(buildings[i])
    else:
        
        Fail.append(buildings[i])
# ---------- end python_2 ----------
python_3 = GhPythonScript(
    buildings=extr_2,
    floorArea=area_5.Area,
    floorNum=number_slider_2,
    oldUnitsNum=round_2.Nearest,
    unitAverageSize=unitaveragesize)  # -> out, newUnitsNum, income, outcome, port, Pass, Fail, port_2, profit; inputs buildings: list, floorArea: list of Int32, floorNum: Int32, oldUnitsNum: list of Int32, unitAverageSize: Int32; same code as python_2

move = Move(Geometry=area_5.Centroid, Motion=Z_2)  # -> Geometry, Transform
move_2 = Move(Geometry=area_4.Centroid, Motion=Z)  # -> Geometry, Transform
tag = TextTag(Location=move.Geometry, Text=python_3.profit)
tag_2 = TextTag(Location=move_2.Geometry, Text=python_2.profit)

preview = CustomPreview(Geometry=[python_2.Pass, python_3.Pass], Material=ColourSwatch(SwatchColor=RGB(0, 255, 0)))
preview_2 = CustomPreview(Geometry=[python_2.Fail, python_3.Fail], Material=ColourSwatch(SwatchColor=RGB(255, 0, 0)))

# ==== cluster Offset_BuildingLines
curves = ClusterInput()  # curves to offset
minlengthtolerance = ClusterInput()  # min Length Tolerance
len = Length(Curve=curves)
larger = LargerThan(FirstNumber=len, SecondNumber=minlengthtolerance)  # -> LargerThan, OrEqualTo
cull = CullPattern(List=curves, CullPattern=larger.LargerThan)
cull_2 = CullPattern(List=curves, CullPattern=invert(larger.LargerThan))
midpt = CurveMiddle(Curve=curves)
rotate = Rotate(Geometry=cull, Angle=degrees(Slider(270, range=0..360)), Plane=midpt)  # -> Geometry, Transform
distance = ClusterInput()  # offset distance
ext = ExtendCurve(Curve=cull_2, Type=0, Start=expr("x+1", distance), End=expr("x+1", distance))
amp = Amplitude(Vector=rotate.Geometry, Amplitude=distance)
move = Move(Geometry=cull, Motion=amp)  # -> Geometry, Transform
merge = Merge(Data1=move.Geometry, Data2=ext)
curves_2 = ClusterOutput(merge)  # curves

# ==== cluster CullRoadsPolygons
plots_curves = ClusterInput()  # plots curves
roads_curves = ClusterInput()  # roads curves
divide = DivideCurve(Curve=roads_curves, Count=Slider(10, range=0..10), Kinks=False)  # -> Points, Tangents, Parameters
incurves = PointInCurves(Point=flatten(divide.Points), Curves=plots_curves)  # -> Relationship, Index, Point
cull_i = CullIndex(List=plots_curves, Indices=incurves.Index, Wrap=True)
plots = ClusterOutput(cull_i)  # plots
