# Grasshopper definition curve_guid.gh (Grasshopper 1.0.7)

crv = Curve([<curve referenced from the Rhino model> x2])
crv_2 = Curve(<curve referenced from the Rhino model>)
python = GhPythonScript(x=crv_2, y=crv)  # -> out, a; inputs y: list
# ---------- python: Python ----------
__author__ = "tanya"
__version__ = "2021.03.17"

import rhinoscriptsyntax as rs

all_objs = rs.AllObjects()

#obj_crv = rs.coercecurve(all_objs[0])
#print(obj_crv)

#pnt = rs.CreatePoint(float(-22), float(-1), float(0))
pnt = rs.CreatePoint(float(42), float(-3), float(0))

counter = 0
for obj in all_objs:
    crv = rs.coercecurve(obj)        
    in_curve = rs.PointInPlanarClosedCurve(pnt, crv)
    
    counter += 1
    
    if(in_curve):
        print(counter, "Tada")
# ---------- end python ----------
panel = Panel(python.a)
